# Grasshopper definition KinergyMainInterface.gh (Grasshopper 1.0.7)
# plug-ins: Human UI

# ---- group: Reciprocated Motion
strength = Slider(0.5, range=0..1)
amplitude = Slider(10, range=0..20)
height = Slider(30, range=0..30)
width = Slider(380, range=0..400)
colour = ColourPicker(PickedColour=RGB(101, 168, 99))
colour_2 = ColourPicker(PickedColour=RGB(230, 230, 230))
titlesize = Slider(20, range=0..30)
width_2 = Slider(385, range=0..400)
height_2 = Slider(30, range=0..30)
width_3 = Slider(566, range=0..1000)
height_3 = Slider(38, range=0..1000)
slider = CreateSlider(Slider=strength, ShowBounds=False, ShowTicks=False, ShowTooltip=False, ShowValLabel=True, showLabel=True)
slider_2 = CreateSlider(Slider=amplitude, ShowBounds=False, ShowTicks=False, ShowTooltip=False, ShowValLabel=True, showLabel=True)
width_4 = Slider(110, range=0..1000)
height_4 = Slider(35, range=0..1000)
separatorheight = Slider(4, range=0..10)
width_5 = Slider(400, range=0..1000)
label = CreateLabel(LabelText="Kinetic Unit for Reciprocated Motion", LabelSize=12, Justification=0)
adjustelem = AdjustElementAppearance(ElementsToAdjust=label, Foreground=colour, FontSize=titlesize)
adjustpos = AdjustElementPositioning(
    ElementsToAdjust=slider,
    Margin="10,5,0,5",
    AbsolutePositioning=False,
    Width=width,
    Height=height,
    HorizontalAlignment=Slider(0, range=0..100))
separatorheight_2 = Slider(4, range=0..10)
separator = CreateSeparator(Thickness=0.5, Horizontal=True, Color=colour_2, Height=separatorheight_2)
adjustpos_2 = AdjustElementPositioning(
    ElementsToAdjust=slider_2,
    Margin="10,0,0,0",
    AbsolutePositioning=False,
    Width=width_2,
    Height=height_2,
    HorizontalAlignment=Slider(0, range=0..100))
adjustpos_3 = AdjustElementPositioning(
    ElementsToAdjust=label,
    Margin="10,5,0,20",
    AbsolutePositioning=False,
    Width=width_3,
    Height=height_3,
    HorizontalAlignment=Slider(0, range=0..100))
height_5 = Slider(34, range=0..1000)
width_6 = Slider(145, range=0..1000)
label_2 = CreateLabel(LabelText="Output trajectory:", LabelSize=12, Justification=0)
colour_3 = ColourPicker(PickedColour=RGB(230, 230, 230))
width_7 = Slider(450, range=0..1000)
label_3 = CreateLabel(LabelText="Reciprocated Motion", LabelSize=12, Justification=0)
panel = Panel("""Uniform
Modified uniform
Uniform acceleration & deceleration""")
adjustpos_4 = AdjustElementPositioning(
    ElementsToAdjust=label_2,
    Margin="10,5,0,10",
    AbsolutePositioning=False,
    Width=width_4,
    Height=height_4,
    HorizontalAlignment=Slider(0, range=0..100))
button = CreateButton(ButtonName="Preview", ButtonStyle=0)
height_6 = Slider(35, range=0..1000)
width_8 = Slider(566, range=0..1000)
height_7 = Slider(38, range=0..1000)
pulldown = CreatePulldownMenu(Label="Pattern", ListItems=panel, showLabel=True)
width_9 = Slider(110, range=0..1000)
height_8 = Slider(35, range=0..1000)
width_10 = Slider(215, range=0..1000)
height_9 = Slider(30, range=0..1000)
checkbox = CreateCheckbox(Label="Add a lock", StartingValue=False)
separator_2 = CreateSeparator(Thickness=0.5, Horizontal=True, Color=colour_3, Width=width_5, Height=separatorheight)
adjustpos_5 = AdjustElementPositioning(
    ElementsToAdjust=pulldown,
    Margin="10,0,0,10",
    AbsolutePositioning=False,
    Width=width_6,
    Height=height_5,
    HorizontalAlignment=Slider(0, range=0..100))
radiobtn = CreateRadioButton(RadioButtonName="Line", RadioButtonGroup="reciprocated_motion_output", InitiallySelected=False)
width_11 = Slider(80, range=0..1000)
height_10 = Slider(30, range=0..1000)
adjustpos_6 = AdjustElementPositioning(ElementsToAdjust=checkbox, Margin="15,5,0,10", AbsolutePositioning=False, Width=width_7, Height=height_6)
width_12 = Slider(125, range=0..1000)
repetitions = Slider(10, range=0..20)
height_11 = Slider(30, range=0..1000)
height_12 = Slider(30, range=0..1000)
width_13 = Slider(145, range=0..1000)
adjustpos_7 = AdjustElementPositioning(
    ElementsToAdjust=button,
    Margin="165,-45,0,10",
    AbsolutePositioning=False,
    Width=width_10,
    Height=height_9,
    HorizontalAlignment=Slider(0, range=0..100))
adjustpos_8 = AdjustElementPositioning(
    ElementsToAdjust=label_3,
    Margin="10,5,0,10",
    AbsolutePositioning=False,
    Width=width_8,
    Height=height_7,
    HorizontalAlignment=Slider(0, range=0..100))
adjustpos_9 = AdjustElementPositioning(
    ElementsToAdjust=radiobtn,
    Margin="125,-55,0,10",
    AbsolutePositioning=False,
    Width=width_9,
    Height=height_8,
    HorizontalAlignment=Slider(0, range=0..100))
separatorheight_3 = Slider(10, range=0..10)
colour_4 = ColourPicker(PickedColour=RGB(230, 230, 230))
width_14 = Slider(400, range=0..1000)
height_13 = Slider(30, range=0..30)
width_15 = Slider(170, range=0..400)
colour_5 = ColourPicker(PickedColour=RGB(51, 121, 200))
true_button = CreateTrueOnlyButton(ButtonName="Select the end-effector", ButtonStyle=0)
true_button_2 = CreateTrueOnlyButton(ButtonName="Set the input", ButtonStyle=0)
slider_3 = CreateSlider(Slider=repetitions, ShowBounds=False, ShowTicks=False, ShowTooltip=False, ShowValLabel=True, showLabel=True)
adjustpos_10 = AdjustElementPositioning(
    ElementsToAdjust=true_button,
    Margin="260,-40,0,15",
    AbsolutePositioning=False,
    Width=width_12,
    Height=height_11,
    HorizontalAlignment=Slider(0, range=0..100))
adjustpos_11 = AdjustElementPositioning(
    ElementsToAdjust=true_button_2,
    Margin="170,-40,0,10",
    AbsolutePositioning=False,
    Width=width_11,
    Height=height_10,
    HorizontalAlignment=Slider(0, range=0..100))
separator_3 = CreateSeparator(Thickness=0.5, Horizontal=True, Color=colour_4, Width=width_14, Height=separatorheight_3)
adjustpos_12 = AdjustElementPositioning(
    ElementsToAdjust=slider_3,
    Margin="170,-55,0,5",
    AbsolutePositioning=False,
    Width=width_15,
    Height=height_13,
    HorizontalAlignment=Slider(0, range=0..100))
height_14 = Slider(35, range=0..1000)
width_16 = Slider(115, range=0..1000)
titlesize_2 = Slider(20, range=0..30)
adjustelem_2 = AdjustElementAppearance(ElementsToAdjust=label_3, Foreground=colour_5, FontSize=titlesize_2)
radiobtn_2 = CreateRadioButton(RadioButtonName="Arc", RadioButtonGroup="reciprocated_motion_output", InitiallySelected=False)
values = ValueListener(Elements=radiobtn, SomeProperty=True)  # -> Values, Indices
values_2 = ValueListener(Elements=radiobtn_2, SomeProperty=True)  # -> Values, Indices
adjustpos_13 = AdjustElementPositioning(
    ElementsToAdjust=radiobtn_2,
    Margin="190,-55,0,10",
    AbsolutePositioning=False,
    Width=width_16,
    Height=height_14,
    HorizontalAlignment=Slider(0, range=0..100))
python = GhPythonScript(x=values.Values, y=values_2.Values)  # -> a
# ---------- python: Python ----------
"""Provides a scripting component.
    Inputs:
        x: Line
        y: Arc
    Output:
        a: Button 1 label"""

__author__ = "ediga"
__version__ = "2020.08.19"

import rhinoscriptsyntax as rs

if x and not y:
    a = "Set the region and direction"
elif not x and y:
    a = "Set the region and axis"
else:
    a = "Set the region and direction"
# ---------- end python ----------
panel_2 = Panel(python)
true_button_3 = CreateTrueOnlyButton(ButtonName=panel_2, ButtonStyle=0)
adjustpos_14 = AdjustElementPositioning(
    ElementsToAdjust=true_button_3,
    Margin="15,0,0,10",
    AbsolutePositioning=False,
    Width=width_13,
    Height=height_12,
    HorizontalAlignment=Slider(0, range=0..100))
merge = Merge(
    Data1=separator,
    Data2=label_3,
    Data3=label_2,
    Data4=radiobtn,
    Data5=radiobtn_2,
    Data9=separator_2,
    Data10=label,
    Data11=true_button_3,
    Data13=true_button_2,
    Data14=true_button,
    Data15=slider,
    Data16=pulldown,
    Data18=slider_3,
    Data19=slider_2,
    Data22=separator_3,
    Data23=checkbox,
    Data24=button)
stack = CreateStack(UIElements=merge, Horizontal=Toggle(False))
hideshow = HideShowElement(ElementToHideShow=stack, Show=True, Collapse=Toggle(True), Disable=Toggle(False))

# ---- group: Continuous Motion
separatorheight_4 = Slider(4, range=0..10)
colour_6 = ColourPicker(PickedColour=RGB(230, 230, 230))
colour_7 = ColourPicker(PickedColour=RGB(101, 168, 99))
separatorheight_5 = Slider(10, range=0..10)
strength_2 = Slider(0.5, range=0..1)
colour_8 = ColourPicker(PickedColour=RGB(230, 230, 230))
width_17 = Slider(400, range=0..1000)
width_18 = Slider(110, range=0..1000)
height_15 = Slider(35, range=0..1000)
width_19 = Slider(380, range=0..400)
height_16 = Slider(30, range=0..30)
width_20 = Slider(566, range=0..1000)
height_17 = Slider(38, range=0..1000)
titlesize_3 = Slider(20, range=0..30)
width_21 = Slider(145, range=0..1000)
height_18 = Slider(30, range=0..1000)
separator_4 = CreateSeparator(Thickness=0.5, Horizontal=True, Color=colour_6, Height=separatorheight_4)
slider_4 = CreateSlider(Slider=strength_2, ShowBounds=False, ShowTicks=False, ShowTooltip=False, ShowValLabel=True, showLabel=True)
separator_5 = CreateSeparator(Thickness=0.5, Horizontal=True, Color=colour_8, Width=width_17, Height=separatorheight_5)
label_4 = CreateLabel(LabelText="Output trajectory:", LabelSize=12, Justification=0)
width_22 = Slider(130, range=0..1000)
height_19 = Slider(35, range=0..1000)
label_5 = CreateLabel(LabelText="Kinetic Unit for Continuous Motion", LabelSize=12, Justification=0)
label_6 = CreateLabel(LabelText="Load motion action:", LabelSize=12, Justification=0)
adjustpos_15 = AdjustElementPositioning(
    ElementsToAdjust=slider_4,
    Margin="10,5,0,10",
    AbsolutePositioning=False,
    Width=width_19,
    Height=height_16,
    HorizontalAlignment=Slider(0, range=0..100))
adjustpos_16 = AdjustElementPositioning(
    ElementsToAdjust=label_4,
    Margin="10,-10,0,10",
    AbsolutePositioning=False,
    Width=width_18,
    Height=height_15,
    HorizontalAlignment=Slider(0, range=0..100))
adjustpos_17 = AdjustElementPositioning(
    ElementsToAdjust=label_5,
    Margin="10,5,0,10",
    AbsolutePositioning=False,
    Width=width_20,
    Height=height_17,
    HorizontalAlignment=Slider(0, range=0..100))
adjustelem_3 = AdjustElementAppearance(ElementsToAdjust=label_5, Foreground=colour_7, FontSize=titlesize_3)
distance = Slider(10, range=0..20)
width_23 = Slider(450, range=0..1000)
height_20 = Slider(35, range=0..1000)
separatorheight_6 = Slider(4, range=0..10)
adjustpos_18 = AdjustElementPositioning(
    ElementsToAdjust=label_6,
    Margin="10,5,0,10",
    AbsolutePositioning=False,
    Width=width_22,
    Height=height_19,
    HorizontalAlignment=Slider(0, range=0..100))
checkbox_2 = CreateCheckbox(Label="Add a lock", StartingValue=False)
colour_9 = ColourPicker(PickedColour=RGB(230, 230, 230))
width_24 = Slider(110, range=0..1000)
height_21 = Slider(35, range=0..1000)
height_22 = Slider(30, range=0..30)
width_25 = Slider(400, range=0..1000)
width_26 = Slider(380, range=0..400)
height_23 = Slider(38, range=0..1000)
label_7 = CreateLabel(LabelText="Continuous Motion", LabelSize=12, Justification=0)
width_27 = Slider(566, range=0..1000)
adjustpos_19 = AdjustElementPositioning(ElementsToAdjust=checkbox_2, Margin="15,5,0,10", AbsolutePositioning=False, Width=width_23, Height=height_20)
width_28 = Slider(110, range=0..1000)
height_24 = Slider(35, range=0..1000)
slider_5 = CreateSlider(Slider=distance, ShowBounds=False, ShowTicks=False, ShowTooltip=False, ShowValLabel=True, showLabel=True)
radiobtn_3 = CreateRadioButton(RadioButtonName="Turn", RadioButtonGroup="continuous_motion_input_action", InitiallySelected=False)
radiobtn_4 = CreateRadioButton(RadioButtonName="Line", RadioButtonGroup="continuous_motion_output_behavior", InitiallySelected=False)
adjustpos_20 = AdjustElementPositioning(
    ElementsToAdjust=slider_5,
    Margin="10,0,0,10",
    AbsolutePositioning=False,
    Width=width_26,
    Height=height_22,
    HorizontalAlignment=Slider(0, range=0..100))
separator_6 = CreateSeparator(Thickness=0.5, Horizontal=True, Color=colour_9, Width=width_25, Height=separatorheight_6)
adjustpos_21 = AdjustElementPositioning(
    ElementsToAdjust=label_7,
    Margin="10,5,0,10",
    AbsolutePositioning=False,
    Width=width_27,
    Height=height_23,
    HorizontalAlignment=Slider(0, range=0..100))
height_25 = Slider(30, range=0..1000)
width_29 = Slider(80, range=0..1000)
width_30 = Slider(125, range=0..1000)
adjustpos_22 = AdjustElementPositioning(
    ElementsToAdjust=radiobtn_4,
    Margin="125,-55,0,10",
    AbsolutePositioning=False,
    Width=width_24,
    Height=height_21,
    HorizontalAlignment=Slider(0, range=0..100))
height_26 = Slider(30, range=0..1000)
adjustpos_23 = AdjustElementPositioning(
    ElementsToAdjust=radiobtn_3,
    Margin="135,-55,0,10",
    AbsolutePositioning=False,
    Width=width_28,
    Height=height_24,
    HorizontalAlignment=Slider(0, range=0..100))
width_31 = Slider(200, range=0..1000)
height_27 = Slider(30, range=0..1000)
titlesize_4 = Slider(20, range=0..30)
colour_10 = ColourPicker(PickedColour=RGB(51, 121, 200))
button_2 = CreateButton(ButtonName="Preview", ButtonStyle=0)
true_button_4 = CreateTrueOnlyButton(ButtonName="Select the end-effector", ButtonStyle=0)
true_button_5 = CreateTrueOnlyButton(ButtonName="Set the input", ButtonStyle=0)
rounds = Slider(10, range=0..20)
width_32 = Slider(115, range=0..1000)
height_28 = Slider(35, range=0..1000)
adjustpos_24 = AdjustElementPositioning(
    ElementsToAdjust=button_2,
    Margin="180,-45,0,10",
    AbsolutePositioning=False,
    Width=width_31,
    Height=height_27,
    HorizontalAlignment=Slider(0, range=0..100))
adjustpos_25 = AdjustElementPositioning(
    ElementsToAdjust=true_button_4,
    Margin="260,-40,0,15",
    AbsolutePositioning=False,
    Width=width_30,
    Height=height_26,
    HorizontalAlignment=Slider(0, range=0..100))
adjustpos_26 = AdjustElementPositioning(
    ElementsToAdjust=true_button_5,
    Margin="170,-40,0,10",
    AbsolutePositioning=False,
    Width=width_29,
    Height=height_25,
    HorizontalAlignment=Slider(0, range=0..100))
adjustelem_4 = AdjustElementAppearance(ElementsToAdjust=label_7, Foreground=colour_10, FontSize=titlesize_4)
radiobtn_5 = CreateRadioButton(RadioButtonName="Circle", RadioButtonGroup="continuous_motion_output_behavior", InitiallySelected=False)
width_33 = Slider(380, range=0..400)
height_29 = Slider(30, range=0..30)
radiobtn_6 = CreateRadioButton(RadioButtonName="Press", RadioButtonGroup="continuous_motion_input_action", InitiallySelected=False)
width_34 = Slider(115, range=0..1000)
height_30 = Slider(35, range=0..1000)
slider_6 = CreateSlider(Slider=rounds, ShowBounds=False, ShowTicks=False, ShowTooltip=False, ShowValLabel=True, showLabel=True)
adjustpos_27 = AdjustElementPositioning(
    ElementsToAdjust=radiobtn_5,
    Margin="190,-55,0,10",
    AbsolutePositioning=False,
    Width=width_32,
    Height=height_28,
    HorizontalAlignment=Slider(0, range=0..100))
adjustpos_28 = AdjustElementPositioning(
    ElementsToAdjust=radiobtn_6,
    Margin="190,-55,0,10",
    AbsolutePositioning=False,
    Width=width_34,
    Height=height_30,
    HorizontalAlignment=Slider(0, range=0..100))
adjustpos_29 = AdjustElementPositioning(
    ElementsToAdjust=slider_6,
    Margin="10,0,0,10",
    AbsolutePositioning=False,
    Width=width_33,
    Height=height_29,
    HorizontalAlignment=Slider(0, range=0..100))
values_3 = ValueListener(Elements=radiobtn_5, SomeProperty=True)  # -> Values, Indices
values_4 = ValueListener(Elements=radiobtn_4, SomeProperty=True)  # -> Values, Indices
python_2 = GhPythonScript(x=values_4.Values, y=values_3.Values)  # -> a, b, c
# ---------- python_2: Python ----------
"""Provides a scripting component.
    Inputs:
        x: Line
        y: Circle
    Output:
        a: Button 1 label
        b: The slide bar for translation
        c: The slide bar for rotation"""

__author__ = "ediga"
__version__ = "2020.08.18"

import rhinoscriptsyntax as rs

if x and not y:
    # translation
    a = "Set the region and direction"
    b = True
    c = False
elif not x and y:
    # rotation
    a = "Set the region and axis"
    b = False
    c = True
else:
    a = "Set the region and direction"
    b = True
    c = False
# ---------- end python_2 ----------
panel_3 = Panel(python_2.a)
true_button_6 = CreateTrueOnlyButton(ButtonName=panel_3, ButtonStyle=0)
adjustpos_30 = AdjustElementPositioning(
    ElementsToAdjust=true_button_6,
    Margin="15,0,0,10",
    AbsolutePositioning=False,
    Width=width_21,
    Height=height_18,
    HorizontalAlignment=Slider(0, range=0..100))
hideshow_2 = HideShowElement(ElementToHideShow=slider_5, Show=python_2.b, Collapse=Toggle(True), Disable=Toggle(False))
hideshow_3 = HideShowElement(ElementToHideShow=slider_6, Show=python_2.c, Collapse=Toggle(True), Disable=Toggle(False))
merge_2 = Merge(
    Data1=separator_4,
    Data2=label_7,
    Data3=label_6,
    Data4=radiobtn_3,
    Data5=radiobtn_6,
    Data7=label_4,
    Data8=radiobtn_4,
    Data9=radiobtn_5,
    Data10=separator_6,
    Data11=label_5,
    Data12=true_button_6,
    Data14=true_button_5,
    Data15=true_button_4,
    Data16=slider_4,
    Data17=slider_5,
    Data18=slider_6,
    Data19=separator_5,
    Data20=checkbox_2,
    Data21=button_2)
stack_2 = CreateStack(UIElements=merge_2, Horizontal=Toggle(False))
values_5 = ValueListener(Elements=radiobtn_6, SomeProperty=True)  # -> Values, Indices
values_6 = ValueListener(Elements=radiobtn_3, SomeProperty=True)  # -> Values, Indices
hideshow_4 = HideShowElement(ElementToHideShow=stack_2, Show=True, Collapse=Toggle(True), Disable=Toggle(False))

# ---- group: Intermittent Motion
separatorheight_7 = Slider(4, range=0..10)
separatorheight_8 = Slider(10, range=0..10)
colour_11 = ColourPicker(PickedColour=RGB(101, 168, 99))
colour_12 = ColourPicker(PickedColour=RGB(230, 230, 230))
width_35 = Slider(400, range=0..1000)
colour_13 = ColourPicker(PickedColour=RGB(230, 230, 230))
width_36 = Slider(566, range=0..1000)
height_31 = Slider(38, range=0..1000)
titlesize_5 = Slider(20, range=0..30)
label_8 = CreateLabel(LabelText="Kinetic Unit for Intermittent Motion", LabelSize=12, Justification=0)
separator_7 = CreateSeparator(Thickness=0.5, Horizontal=True, Color=colour_13, Width=width_35, Height=separatorheight_8)
separator_8 = CreateSeparator(Thickness=0.5, Horizontal=True, Color=colour_12, Height=separatorheight_7)
width_37 = Slider(145, range=0..1000)
height_32 = Slider(30, range=0..1000)
adjustpos_31 = AdjustElementPositioning(
    ElementsToAdjust=label_8,
    Margin="10,0,0,20",
    AbsolutePositioning=False,
    Width=width_36,
    Height=height_31,
    HorizontalAlignment=Slider(0, range=0..100))
adjustelem_5 = AdjustElementAppearance(ElementsToAdjust=label_8, Foreground=colour_11, FontSize=titlesize_5)
width_38 = Slider(566, range=0..1000)
height_33 = Slider(38, range=0..1000)
width_39 = Slider(80, range=0..1000)
height_34 = Slider(30, range=0..1000)
times = Slider(10, range=0..20)
amplitude_2 = Slider(10, range=0..20)
strength_3 = Slider(0.5, range=0..1)
width_40 = Slider(380, range=0..400)
height_35 = Slider(30, range=0..30)
width_41 = Slider(380, range=0..400)
width_42 = Slider(380, range=0..400)
true_button_7 = CreateTrueOnlyButton(ButtonName="Set the region and direction", ButtonStyle=0)
width_43 = Slider(125, range=0..1000)
height_36 = Slider(30, range=0..30)
height_37 = Slider(30, range=0..30)
height_38 = Slider(30, range=0..1000)
label_9 = CreateLabel(LabelText="Intermittent Motion", LabelSize=12, Justification=0)
true_button_8 = CreateTrueOnlyButton(ButtonName="Set the input", ButtonStyle=0)
adjustpos_32 = AdjustElementPositioning(
    ElementsToAdjust=true_button_7,
    Margin="15,0,0,10",
    AbsolutePositioning=False,
    Width=width_37,
    Height=height_32,
    HorizontalAlignment=Slider(0, range=0..100))
width_44 = Slider(200, range=0..1000)
height_39 = Slider(30, range=0..1000)
adjustpos_33 = AdjustElementPositioning(
    ElementsToAdjust=label_9,
    Margin="10,5,0,5",
    AbsolutePositioning=False,
    Width=width_38,
    Height=height_33,
    HorizontalAlignment=Slider(0, range=0..100))
adjustpos_34 = AdjustElementPositioning(
    ElementsToAdjust=true_button_8,
    Margin="170,-40,0,10",
    AbsolutePositioning=False,
    Width=width_39,
    Height=height_34,
    HorizontalAlignment=Slider(0, range=0..100))
width_45 = Slider(450, range=0..1000)
height_40 = Slider(35, range=0..1000)
button_3 = CreateButton(ButtonName="Preview", ButtonStyle=0)
slider_7 = CreateSlider(Slider=strength_3, ShowBounds=False, ShowTicks=False, ShowTooltip=False, ShowValLabel=True, showLabel=True)
true_button_9 = CreateTrueOnlyButton(ButtonName="Select the end-effector", ButtonStyle=0)
slider_8 = CreateSlider(Slider=times, ShowBounds=False, ShowTicks=False, ShowTooltip=False, ShowValLabel=True, showLabel=True)
slider_9 = CreateSlider(Slider=amplitude_2, ShowBounds=False, ShowTicks=False, ShowTooltip=False, ShowValLabel=True, showLabel=True)
checkbox_3 = CreateCheckbox(Label="Add a lock", StartingValue=False)
adjustpos_35 = AdjustElementPositioning(
    ElementsToAdjust=button_3,
    Margin="180,-45,0,10",
    AbsolutePositioning=False,
    Width=width_44,
    Height=height_39,
    HorizontalAlignment=Slider(0, range=0..100))
adjustpos_36 = AdjustElementPositioning(
    ElementsToAdjust=true_button_9,
    Margin="260,-40,0,20",
    AbsolutePositioning=False,
    Width=width_43,
    Height=height_38,
    HorizontalAlignment=Slider(0, range=0..100))
adjustpos_37 = AdjustElementPositioning(ElementsToAdjust=checkbox_3, Margin="15,15,0,10", AbsolutePositioning=False, Width=width_45, Height=height_40)
adjustpos_38 = AdjustElementPositioning(
    ElementsToAdjust=slider_7,
    Margin="10,15,0,20",
    AbsolutePositioning=False,
    Width=width_40,
    Height=height_35,
    HorizontalAlignment=Slider(0, range=0..100))
adjustpos_39 = AdjustElementPositioning(
    ElementsToAdjust=slider_8,
    Margin="10,0,0,5",
    AbsolutePositioning=False,
    Width=width_41,
    Height=height_36,
    HorizontalAlignment=Slider(0, range=0..100))
adjustpos_40 = AdjustElementPositioning(
    ElementsToAdjust=slider_9,
    Margin="10,15,0,15",
    AbsolutePositioning=False,
    Width=width_42,
    Height=height_37,
    HorizontalAlignment=Slider(0, range=0..100))
titlesize_6 = Slider(20, range=0..30)
colour_14 = ColourPicker(PickedColour=RGB(51, 121, 200))
adjustelem_6 = AdjustElementAppearance(ElementsToAdjust=label_9, Foreground=colour_14, FontSize=titlesize_6)
merge_3 = Merge(
    Data1=separator_8,
    Data2=label_9,
    Data3=label_8,
    Data4=true_button_7,
    Data6=true_button_8,
    Data7=true_button_9,
    Data8=slider_7,
    Data9=slider_8,
    Data10=slider_9,
    Data11=separator_7,
    Data12=checkbox_3,
    Data13=button_3)
stack_3 = CreateStack(UIElements=merge_3, Horizontal=Toggle(False))
hideshow_5 = HideShowElement(ElementToHideShow=stack_3, Show=True, Collapse=Toggle(True), Disable=Toggle(False))

# ----
arc = Panel(values_2.Values)
line = Panel(values.Values)
turn_input = Panel(values_6.Values)
press_input = Panel(values_5.Values)
line_2 = Panel(values_4.Values)
circle = Panel(values_3.Values)

# ---- group: Entry Interface
height_41 = Slider(35, range=0..1000)
width_46 = Slider(186, range=0..1000)
height_42 = Slider(35, range=0..1000)
width_47 = Slider(186, range=0..1000)
width_48 = Slider(186, range=0..1000)
label_10 = CreateLabel(LabelText="Periodic Motion", LabelSize=12, Justification=0)
adjustpos_41 = AdjustElementPositioning(
    ElementsToAdjust=label_10,
    Margin="40,40,0,5",
    AbsolutePositioning=False,
    Width=width_46,
    Height=height_41,
    HorizontalAlignment=Slider(0, range=0..100))
height_43 = Slider(35, range=0..1000)
label_11 = CreateLabel(LabelText="Non-periodic Motion", LabelSize=12, Justification=0)
adjustpos_42 = AdjustElementPositioning(
    ElementsToAdjust=label_11,
    Margin="10,30,0,5",
    AbsolutePositioning=False,
    Width=width_47,
    Height=height_42,
    HorizontalAlignment=Slider(0, range=0..100))
width_49 = Slider(120, range=0..1000)
width_50 = Slider(150, range=0..1000)
height_44 = Slider(35, range=0..1000)
height_45 = Slider(35, range=0..1000)
height_46 = Slider(35, range=0..1000)
width_51 = Slider(150, range=0..1000)
height_47 = Slider(35, range=0..1000)
width_52 = Slider(150, range=0..1000)
width_53 = Slider(150, range=0..1000)
height_48 = Slider(35, range=0..1000)
height_49 = Slider(35, range=0..1000)
width_54 = Slider(150, range=0..1000)
width_55 = Slider(329, range=0..1000)
height_50 = Slider(35, range=0..1000)
titlesize_7 = Slider(20, range=0..30)
radiobtn_7 = CreateRadioButton(RadioButtonName="Continuous rotation", RadioButtonGroup="motion type", InitiallySelected=False)
adjustpos_43 = AdjustElementPositioning(
    ElementsToAdjust=radiobtn_7,
    Margin="150,-120,0,10",
    AbsolutePositioning=False,
    Width=width_50,
    Height=height_45,
    HorizontalAlignment=Slider(0, range=0..100))
radiobtn_8 = CreateRadioButton(RadioButtonName="Reciprocation", RadioButtonGroup="motion type", InitiallySelected=False)
adjustpos_44 = AdjustElementPositioning(
    ElementsToAdjust=radiobtn_8,
    Margin="150,-70,0,10",
    AbsolutePositioning=False,
    Width=width_51,
    Height=height_47,
    HorizontalAlignment=Slider(0, range=0..100))
radiobtn_9 = CreateRadioButton(RadioButtonName="Intermittent Oscillation", RadioButtonGroup="motion type", InitiallySelected=False)
adjustpos_45 = AdjustElementPositioning(
    ElementsToAdjust=radiobtn_9,
    Margin="150,-30,0,10",
    AbsolutePositioning=False,
    Width=width_52,
    Height=height_48,
    HorizontalAlignment=Slider(0, range=0..100))
radiobtn_10 = CreateRadioButton(RadioButtonName="Intermittent Rotation", RadioButtonGroup="motion type", InitiallySelected=False)
adjustpos_46 = AdjustElementPositioning(
    ElementsToAdjust=radiobtn_10,
    Margin="150,-15,0,10",
    AbsolutePositioning=False,
    Width=width_53,
    Height=height_49,
    HorizontalAlignment=Slider(0, range=0..100))
radiobtn_11 = CreateRadioButton(RadioButtonName="Instant translation", RadioButtonGroup="motion type", InitiallySelected=False)
adjustpos_47 = AdjustElementPositioning(
    ElementsToAdjust=radiobtn_11,
    Margin="150,-95,0,10",
    AbsolutePositioning=False,
    Width=width_48,
    Height=height_43,
    HorizontalAlignment=Slider(0, range=0..100))
radiobtn_12 = CreateRadioButton(RadioButtonName="Continuous translation", RadioButtonGroup="motion type", InitiallySelected=False)
adjustpos_48 = AdjustElementPositioning(
    ElementsToAdjust=radiobtn_12,
    Margin="150,-20,0,10",
    AbsolutePositioning=False,
    Width=width_54,
    Height=height_46,
    HorizontalAlignment=Slider(0, range=0..100))
radiobtn_13 = CreateRadioButton(RadioButtonName="Instant rotation", RadioButtonGroup="motion type", InitiallySelected=False)
adjustpos_49 = AdjustElementPositioning(
    ElementsToAdjust=radiobtn_13,
    Margin="150,-45,0,10",
    AbsolutePositioning=False,
    Width=width_49,
    Height=height_44,
    HorizontalAlignment=Slider(0, range=0..100))
label_12 = CreateLabel(LabelText="Select a target motion type:", LabelSize=12, Justification=0)
adjustpos_50 = AdjustElementPositioning(
    ElementsToAdjust=label_12,
    Margin="0,0,0,5",
    AbsolutePositioning=False,
    Width=width_55,
    Height=height_50,
    HorizontalAlignment=Slider(0, range=0..100))
adjustelem_7 = AdjustElementAppearance(ElementsToAdjust=label_12, FontSize=titlesize_7)

# ---- group: Motion Selection
values_7 = ValueListener(Elements=radiobtn_11, SomeProperty=True)  # -> Values, Indices
values_8 = ValueListener(Elements=radiobtn_13, SomeProperty=True)  # -> Values, Indices
values_9 = ValueListener(Elements=radiobtn_12, SomeProperty=True)  # -> Values, Indices
values_10 = ValueListener(Elements=radiobtn_7, SomeProperty=True)  # -> Values, Indices
values_11 = ValueListener(Elements=radiobtn_8, SomeProperty=True)  # -> Values, Indices
values_12 = ValueListener(Elements=radiobtn_10, SomeProperty=True)  # -> Values, Indices
values_13 = ValueListener(Elements=radiobtn_9, SomeProperty=True)  # -> Values, Indices
python_3 = GhPythonScript(
    x=values_7.Values,
    y=values_8.Values,
    z=values_9.Values,
    u=values_10.Values,
    v=values_11.Values,
    w=values_13.Values,
    s=values_12.Values)  # -> a, b, c, d, e, f, g, h
# ---------- python_3: Python ----------
#provides a scripting component.
#    Inputs:
#        x: Instant translation
#        y: Instant rotation
#        z: Continuous translation
#        u: Continuous rotation
#        v: Reciprocation
#        w: Intermittent oscillation
#        s: Intermittent rotation
#    Output:
#        a: Visibility indicator for instant translation control panel
#        b: Visibility indicator for instant rotation control panel
#        c: Visibility indicator for continuous translation control panel
#        d: Visibility indicator for continuous rotation control panel
#        e: Visibility indicator for the default control panel
#        f: Visibility indicator for reciprocation control panel
#        g: Visibility indicator for intermittent oscillation control panel
#        h: Visibility indicator for intermittent rotation control panel
#
#__author__ = "ediga"
#__version__ = "2020.07.28"

import rhinoscriptsyntax as rs


if x and not y and not z and not u and not v and not w and not s:
    a = True
    b = False
    c = False
    d = False
    e = False
    f = False
    g = False
    h = False
elif not x and y and not z and not u and not v and not w and not s:
    a = False
    b = True
    c = False
    d = False
    e = False
    f = False
    g = False
    h = False
elif not x and not y and z and not u and not v and not w and not s:
    a = False
    b = False
    c = True
    d = False
    e = False
    f = False
    g = False
    h = False
elif not x and not y and not z and u and not v and not w and not s:
    a = False
    b = False
    c = False
    d = True
    e = False
    f = False
    g = False
    h = False
elif not x and not y and not z and not u and v and not w and not s:
    a = False
    b = False
    c = False
    d = False
    e = False
    f = True
    g = False
    h = False
elif not x and not y and not z and not u and not v and w and not s:
    a = False
    b = False
    c = False
    d = False
    e = False
    f = False
    g = True
    h = False
elif not x and not y and not z and not u and not v and not w and s:
    a = False
    b = False
    c = False
    d = False
    e = False
    f = False
    g = False
    h = True
else:
    a = False
    b = False
    c = False
    d = False
    e = True
    f = False
    g = False
    h = False
# ---------- end python_3 ----------
instant_rotation = Panel(values_8.Values)
instant_translation = Panel(values_7.Values)
continuous_translation = Panel(values_9.Values)
continuous_rotation = Panel(values_10.Values)
intermittent_oscillation = Panel(values_13.Values)
reciprocation = Panel(values_11.Values)
intermittent_rotation = Panel(values_12.Values)

# ---- group: Reciprocation Control Panel
height_51 = Slider(30, range=0..30)
width_56 = Slider(50, range=0..400)
label_13 = CreateLabel(LabelText="Max", LabelSize=12, Justification=0)
adjustpos_51 = AdjustElementPositioning(
    ElementsToAdjust=label_13,
    Margin="186,-45,0,5",
    AbsolutePositioning=False,
    Width=width_56,
    Height=height_51,
    HorizontalAlignment=Slider(0, range=0..100))
adjustelem_8 = AdjustElementAppearance(ElementsToAdjust=label_13, Background="255,255,255")
height_52 = Slider(34, range=0..1000)
width_57 = Slider(110, range=0..1000)
width_58 = Slider(80, range=0..1000)
height_53 = Slider(30, range=0..1000)
panel_4 = Panel("""Uniform acceleration & deceleration
Slightly rising & suddenly falling""")
c_script = CSharpScript()  # -> out, A
# ---------- c_script: C# ----------
    GH_Document gh_d = owner.OnPingDocument();

    if (gh_d.IsFilePathDefined)
    {
      Print("A path is defined.");
      A = gh_d.FilePath;
    }
    else
    {
      Print("No path defined.");
    }
# ---------- end c_script ----------
height_54 = Slider(30, range=0..30)
width_59 = Slider(50, range=0..400)
python_4 = GhPythonScript(x=c_script.A)  # -> a
# ---------- python_4: Python ----------
__author__ = "ediga"
__version__ = "2020.08.24"

import rhinoscriptsyntax as rs

idx = x.index("KinergyMainInterface.gh")

a = x[0:idx] + "Resources\images\\reciprocate.png"
# ---------- end python_4 ----------
pulldown_2 = CreatePulldownMenu(Label="Pattern", ListItems=panel_4, showLabel=True)
width_60 = Slider(150, range=0..1000)
height_55 = Slider(80, range=0..1000)
width_61 = Slider(117, range=0..1000)
height_56 = Slider(112, range=0..1000)
label_14 = CreateLabel(LabelText="Max", LabelSize=12, Justification=0)
panel_5 = Panel(python_4)
button_4 = CreateButton(ButtonName="Set the input", ButtonStyle=0)
adjustpos_52 = AdjustElementPositioning(
    ElementsToAdjust=pulldown_2,
    Margin="210,-45,0,10",
    AbsolutePositioning=False,
    Width=width_57,
    Height=height_52,
    HorizontalAlignment=Slider(0, range=0..100))
adjustpos_53 = AdjustElementPositioning(
    ElementsToAdjust=label_14,
    Margin="295,-45,0,5",
    AbsolutePositioning=False,
    Width=width_59,
    Height=height_54,
    HorizontalAlignment=Slider(0, range=0..100))
adjustelem_9 = AdjustElementAppearance(ElementsToAdjust=label_14, Background="255,255,255")
adjustpos_54 = AdjustElementPositioning(
    ElementsToAdjust=button_4,
    Margin="10,-40,0,10",
    AbsolutePositioning=False,
    Width=width_58,
    Height=height_53,
    HorizontalAlignment=Slider(0, range=0..100))
image = CreateImage(ImageSource=panel_5, ImageWidth=width_61, ImageHeight=height_56)
adjustpos_55 = AdjustElementPositioning(
    ElementsToAdjust=image,
    Margin="240,-90,0,10",
    AbsolutePositioning=False,
    Width=width_60,
    Height=height_55,
    HorizontalAlignment=Slider(0, range=0..100))
separatorheight_9 = Slider(4, range=0..10)
strength_4 = Slider(4, range=0..9)
colour_15 = ColourPicker(PickedColour=RGB(230, 230, 230))
amplitude_3 = Slider(2, range=0..4)
width_62 = Slider(122, range=0..1000)
height_57 = Slider(30, range=0..1000)
width_63 = Slider(305, range=0..400)
height_58 = Slider(30, range=0..30)
width_64 = Slider(210, range=0..1000)
height_59 = Slider(30, range=0..1000)
width_65 = Slider(180, range=0..400)
height_60 = Slider(30, range=0..30)
titlesize_8 = Slider(18, range=0..30)
separator_9 = CreateSeparator(Thickness=0.5, Horizontal=True, Color=colour_15, Height=separatorheight_9)
colour_16 = ColourPicker(PickedColour=RGB(51, 121, 200))
button_5 = CreateButton(ButtonName="Select the end-effector", ButtonStyle=0)
slider_10 = CreateSlider(Slider=strength_4, ShowBounds=False, ShowTicks=False, ShowTooltip=False, ShowValLabel=True, showLabel=True)
slider_11 = CreateSlider(Slider=amplitude_3, ShowBounds=False, ShowTicks=False, ShowTooltip=False, ShowValLabel=True, showLabel=True)
button_6 = CreateButton(ButtonName="Select the region and direction", ButtonStyle=0)
width_66 = Slider(566, range=0..1000)
height_61 = Slider(38, range=0..1000)
adjustpos_56 = AdjustElementPositioning(
    ElementsToAdjust=slider_10,
    Margin="10,20,0,10",
    AbsolutePositioning=False,
    Width=width_63,
    Height=height_58,
    HorizontalAlignment=Slider(0, range=0..100))
adjustpos_57 = AdjustElementPositioning(
    ElementsToAdjust=button_5,
    Margin="100,5,0,10",
    AbsolutePositioning=False,
    Width=width_62,
    Height=height_57,
    HorizontalAlignment=Slider(0, range=0..100))
adjustpos_58 = AdjustElementPositioning(
    ElementsToAdjust=slider_11,
    Margin="10,10,0,5",
    AbsolutePositioning=False,
    Width=width_65,
    Height=height_60,
    HorizontalAlignment=Slider(0, range=0..100))
adjustpos_59 = AdjustElementPositioning(
    ElementsToAdjust=button_6,
    Margin="10,0,0,10",
    AbsolutePositioning=False,
    Width=width_64,
    Height=height_59,
    HorizontalAlignment=Slider(0, range=0..100))
colour_17 = ColourPicker(PickedColour=RGB(230, 230, 230))
separatorheight_10 = Slider(10, range=0..10)
width_67 = Slider(400, range=0..1000)
label_15 = CreateLabel(LabelText="Kinetic Unit for Reciprocation", LabelSize=12, Justification=0)
adjustelem_10 = AdjustElementAppearance(ElementsToAdjust=label_15, Foreground=colour_16, FontSize=titlesize_8)
adjustpos_60 = AdjustElementPositioning(
    ElementsToAdjust=label_15,
    Margin="0,5,0,10",
    AbsolutePositioning=False,
    Width=width_66,
    Height=height_61,
    HorizontalAlignment=Slider(0, range=0..100))
width_68 = Slider(170, range=0..1000)
height_62 = Slider(30, range=0..1000)
width_69 = Slider(450, range=0..1000)
checkbox_4 = CreateCheckbox(Label="Add a lock", StartingValue=False)
height_63 = Slider(35, range=0..1000)
button_7 = CreateButton(ButtonName="Preview", ButtonStyle=0)
separator_10 = CreateSeparator(Thickness=0.5, Horizontal=True, Color=colour_17, Width=width_67, Height=separatorheight_10)
merge_4 = Merge(
    Data1=separator_9,
    Data2=label_15,
    Data3=button_6,
    Data4=button_5,
    Data5=image,
    Data6=button_4,
    Data7=slider_10,
    Data8=label_14,
    Data9=slider_11,
    Data10=label_13,
    Data11=pulldown_2,
    Data12=separator_10,
    Data13=checkbox_4,
    Data14=button_7)
adjustpos_61 = AdjustElementPositioning(
    ElementsToAdjust=button_7,
    Margin="150,-45,0,10",
    AbsolutePositioning=False,
    Width=width_68,
    Height=height_62,
    HorizontalAlignment=Slider(0, range=0..100))
adjustpos_62 = AdjustElementPositioning(ElementsToAdjust=checkbox_4, Margin="15,15,0,10", AbsolutePositioning=False, Width=width_69, Height=height_63)
stack_4 = CreateStack(UIElements=merge_4, Horizontal=Toggle(False))
hideshow_6 = HideShowElement(ElementToHideShow=stack_4, Show=python_3.f, Collapse=Toggle(True), Disable=Toggle(False))

# ---- group: Intermittent Oscillation Control Panel
height_64 = Slider(30, range=0..30)
width_70 = Slider(50, range=0..400)
label_16 = CreateLabel(LabelText="Max", LabelSize=12, Justification=0)
adjustpos_63 = AdjustElementPositioning(
    ElementsToAdjust=label_16,
    Margin="186,-45,0,5",
    AbsolutePositioning=False,
    Width=width_70,
    Height=height_64,
    HorizontalAlignment=Slider(0, range=0..100))
adjustelem_11 = AdjustElementAppearance(ElementsToAdjust=label_16, Background="255,255,255")
height_65 = Slider(34, range=0..1000)
width_71 = Slider(110, range=0..1000)
width_72 = Slider(80, range=0..1000)
height_66 = Slider(30, range=0..1000)
c_script_2 = CSharpScript()  # -> out, A; same code as c_script
python_5 = GhPythonScript(x=c_script_2.A)  # -> a
# ---------- python_5: Python ----------
__author__ = "ediga"
__version__ = "2020.08.24"

import rhinoscriptsyntax as rs

idx = x.index("KinergyMainInterface.gh")

a = x[0:idx] + "Resources\images\intosci.png"
# ---------- end python_5 ----------
height_67 = Slider(30, range=0..30)
width_73 = Slider(50, range=0..400)
width_74 = Slider(150, range=0..1000)
height_68 = Slider(80, range=0..1000)
panel_6 = Panel("""Slow
Regular
Fast""")
width_75 = Slider(117, range=0..1000)
height_69 = Slider(112, range=0..1000)
panel_7 = Panel(python_5)
label_17 = CreateLabel(LabelText="Max", LabelSize=12, Justification=0)
pulldown_3 = CreatePulldownMenu(Label="Speed", ListItems=panel_6, showLabel=True)
button_8 = CreateButton(ButtonName="Set the input", ButtonStyle=0)
adjustpos_64 = AdjustElementPositioning(
    ElementsToAdjust=label_17,
    Margin="295,-45,0,5",
    AbsolutePositioning=False,
    Width=width_73,
    Height=height_67,
    HorizontalAlignment=Slider(0, range=0..100))
adjustelem_12 = AdjustElementAppearance(ElementsToAdjust=label_17, Background="255,255,255")
adjustpos_65 = AdjustElementPositioning(
    ElementsToAdjust=pulldown_3,
    Margin="210,-45,0,10",
    AbsolutePositioning=False,
    Width=width_71,
    Height=height_65,
    HorizontalAlignment=Slider(0, range=0..100))
adjustpos_66 = AdjustElementPositioning(
    ElementsToAdjust=button_8,
    Margin="10,-40,0,10",
    AbsolutePositioning=False,
    Width=width_72,
    Height=height_66,
    HorizontalAlignment=Slider(0, range=0..100))
image_2 = CreateImage(ImageSource=panel_7, ImageWidth=width_75, ImageHeight=height_69)
adjustpos_67 = AdjustElementPositioning(
    ElementsToAdjust=image_2,
    Margin="240,-90,0,10",
    AbsolutePositioning=False,
    Width=width_74,
    Height=height_68,
    HorizontalAlignment=Slider(0, range=0..100))
separatorheight_11 = Slider(4, range=0..10)
strength_5 = Slider(4, range=0..9)
colour_18 = ColourPicker(PickedColour=RGB(230, 230, 230))
amplitude_4 = Slider(2, range=0..4)
width_76 = Slider(122, range=0..1000)
height_70 = Slider(30, range=0..1000)
width_77 = Slider(305, range=0..400)
height_71 = Slider(30, range=0..30)
width_78 = Slider(210, range=0..1000)
height_72 = Slider(30, range=0..1000)
width_79 = Slider(180, range=0..400)
height_73 = Slider(30, range=0..30)
titlesize_9 = Slider(18, range=0..30)
separator_11 = CreateSeparator(Thickness=0.5, Horizontal=True, Color=colour_18, Height=separatorheight_11)
colour_19 = ColourPicker(PickedColour=RGB(51, 121, 200))
button_9 = CreateButton(ButtonName="Select the end-effector", ButtonStyle=0)
slider_12 = CreateSlider(Slider=strength_5, ShowBounds=False, ShowTicks=False, ShowTooltip=False, ShowValLabel=True, showLabel=True)
slider_13 = CreateSlider(Slider=amplitude_4, ShowBounds=False, ShowTicks=False, ShowTooltip=False, ShowValLabel=True, showLabel=True)
button_10 = CreateButton(ButtonName="Select the region and axis", ButtonStyle=0)
width_80 = Slider(566, range=0..1000)
height_74 = Slider(38, range=0..1000)
adjustpos_68 = AdjustElementPositioning(
    ElementsToAdjust=slider_12,
    Margin="10,20,0,10",
    AbsolutePositioning=False,
    Width=width_77,
    Height=height_71,
    HorizontalAlignment=Slider(0, range=0..100))
adjustpos_69 = AdjustElementPositioning(
    ElementsToAdjust=button_9,
    Margin="100,5,0,10",
    AbsolutePositioning=False,
    Width=width_76,
    Height=height_70,
    HorizontalAlignment=Slider(0, range=0..100))
adjustpos_70 = AdjustElementPositioning(
    ElementsToAdjust=slider_13,
    Margin="10,10,0,5",
    AbsolutePositioning=False,
    Width=width_79,
    Height=height_73,
    HorizontalAlignment=Slider(0, range=0..100))
adjustpos_71 = AdjustElementPositioning(
    ElementsToAdjust=button_10,
    Margin="10,0,0,10",
    AbsolutePositioning=False,
    Width=width_78,
    Height=height_72,
    HorizontalAlignment=Slider(0, range=0..100))
colour_20 = ColourPicker(PickedColour=RGB(230, 230, 230))
separatorheight_12 = Slider(10, range=0..10)
width_81 = Slider(400, range=0..1000)
label_18 = CreateLabel(LabelText="Kinetic Unit for Intermittent Oscillation", LabelSize=12, Justification=0)
adjustelem_13 = AdjustElementAppearance(ElementsToAdjust=label_18, Foreground=colour_19, FontSize=titlesize_9)
adjustpos_72 = AdjustElementPositioning(
    ElementsToAdjust=label_18,
    Margin="0,5,0,10",
    AbsolutePositioning=False,
    Width=width_80,
    Height=height_74,
    HorizontalAlignment=Slider(0, range=0..100))
width_82 = Slider(170, range=0..1000)
height_75 = Slider(30, range=0..1000)
width_83 = Slider(450, range=0..1000)
checkbox_5 = CreateCheckbox(Label="Add a lock", StartingValue=False)
height_76 = Slider(35, range=0..1000)
button_11 = CreateButton(ButtonName="Preview", ButtonStyle=0)
separator_12 = CreateSeparator(Thickness=0.5, Horizontal=True, Color=colour_20, Width=width_81, Height=separatorheight_12)
merge_5 = Merge(
    Data1=separator_11,
    Data2=label_18,
    Data3=button_10,
    Data4=button_9,
    Data5=image_2,
    Data6=button_8,
    Data7=slider_12,
    Data8=label_17,
    Data9=slider_13,
    Data10=label_16,
    Data11=pulldown_3,
    Data12=separator_12,
    Data13=checkbox_5,
    Data14=button_11)
adjustpos_73 = AdjustElementPositioning(
    ElementsToAdjust=button_11,
    Margin="150,-45,0,10",
    AbsolutePositioning=False,
    Width=width_82,
    Height=height_75,
    HorizontalAlignment=Slider(0, range=0..100))
adjustpos_74 = AdjustElementPositioning(ElementsToAdjust=checkbox_5, Margin="15,15,0,10", AbsolutePositioning=False, Width=width_83, Height=height_76)
stack_5 = CreateStack(UIElements=merge_5, Horizontal=Toggle(False))
hideshow_7 = HideShowElement(ElementToHideShow=stack_5, Show=python_3.g, Collapse=Toggle(True), Disable=Toggle(False))

# ---- group: Continuous Translation Control Panel
width_84 = Slider(80, range=0..1000)
height_77 = Slider(30, range=0..1000)
height_78 = Slider(30, range=0..30)
width_85 = Slider(50, range=0..400)
height_79 = Slider(30, range=0..30)
width_86 = Slider(50, range=0..400)
c_script_3 = CSharpScript()  # -> out, A; same code as c_script
python_6 = GhPythonScript(x=c_script_3.A)  # -> a
# ---------- python_6: Python ----------
__author__ = "ediga"
__version__ = "2020.08.24"

import rhinoscriptsyntax as rs

idx = x.index("KinergyMainInterface.gh")

a = x[0:idx] + "Resources\images\contrans.png"
# ---------- end python_6 ----------
width_87 = Slider(150, range=0..1000)
height_80 = Slider(80, range=0..1000)
label_19 = CreateLabel(LabelText="Far", LabelSize=12, Justification=0)
label_20 = CreateLabel(LabelText="Max", LabelSize=12, Justification=0)
width_88 = Slider(117, range=0..1000)
height_81 = Slider(112, range=0..1000)
panel_8 = Panel(python_6)
button_12 = CreateButton(ButtonName="Set the input", ButtonStyle=0)
adjustpos_75 = AdjustElementPositioning(
    ElementsToAdjust=label_19,
    Margin="295,-45,0,5",
    AbsolutePositioning=False,
    Width=width_85,
    Height=height_78,
    HorizontalAlignment=Slider(0, range=0..100))
adjustelem_14 = AdjustElementAppearance(ElementsToAdjust=label_19, Background="255,255,255")
adjustpos_76 = AdjustElementPositioning(
    ElementsToAdjust=label_20,
    Margin="295,-45,0,5",
    AbsolutePositioning=False,
    Width=width_86,
    Height=height_79,
    HorizontalAlignment=Slider(0, range=0..100))
adjustelem_15 = AdjustElementAppearance(ElementsToAdjust=label_20, Background="255,255,255")
adjustpos_77 = AdjustElementPositioning(
    ElementsToAdjust=button_12,
    Margin="10,-40,0,10",
    AbsolutePositioning=False,
    Width=width_84,
    Height=height_77,
    HorizontalAlignment=Slider(0, range=0..100))
image_3 = CreateImage(ImageSource=panel_8, ImageWidth=width_88, ImageHeight=height_81)
adjustpos_78 = AdjustElementPositioning(
    ElementsToAdjust=image_3,
    Margin="240,-90,0,10",
    AbsolutePositioning=False,
    Width=width_87,
    Height=height_80,
    HorizontalAlignment=Slider(0, range=0..100))
separatorheight_13 = Slider(4, range=0..10)
strength_6 = Slider(4, range=0..9)
colour_21 = ColourPicker(PickedColour=RGB(230, 230, 230))
distance_2 = Slider(4, range=0..9)
width_89 = Slider(122, range=0..1000)
height_82 = Slider(30, range=0..1000)
width_90 = Slider(330, range=0..400)
height_83 = Slider(30, range=0..30)
width_91 = Slider(210, range=0..1000)
height_84 = Slider(30, range=0..1000)
width_92 = Slider(330, range=0..400)
height_85 = Slider(30, range=0..30)
titlesize_10 = Slider(18, range=0..30)
separator_13 = CreateSeparator(Thickness=0.5, Horizontal=True, Color=colour_21, Height=separatorheight_13)
colour_22 = ColourPicker(PickedColour=RGB(51, 121, 200))
slider_14 = CreateSlider(Slider=strength_6, ShowBounds=False, ShowTicks=False, ShowTooltip=False, ShowValLabel=True, showLabel=True)
slider_15 = CreateSlider(Slider=distance_2, ShowBounds=False, ShowTicks=False, ShowTooltip=False, ShowValLabel=True, showLabel=True)
button_13 = CreateButton(ButtonName="Select the end-effector", ButtonStyle=0)
button_14 = CreateButton(ButtonName="Select the region and direction", ButtonStyle=0)
width_93 = Slider(566, range=0..1000)
height_86 = Slider(38, range=0..1000)
adjustpos_79 = AdjustElementPositioning(
    ElementsToAdjust=slider_14,
    Margin="10,20,0,10",
    AbsolutePositioning=False,
    Width=width_90,
    Height=height_83,
    HorizontalAlignment=Slider(0, range=0..100))
adjustpos_80 = AdjustElementPositioning(
    ElementsToAdjust=button_13,
    Margin="100,5,0,10",
    AbsolutePositioning=False,
    Width=width_89,
    Height=height_82,
    HorizontalAlignment=Slider(0, range=0..100))
adjustpos_81 = AdjustElementPositioning(
    ElementsToAdjust=slider_15,
    Margin="10,10,0,5",
    AbsolutePositioning=False,
    Width=width_92,
    Height=height_85,
    HorizontalAlignment=Slider(0, range=0..100))
adjustpos_82 = AdjustElementPositioning(
    ElementsToAdjust=button_14,
    Margin="10,0,0,10",
    AbsolutePositioning=False,
    Width=width_91,
    Height=height_84,
    HorizontalAlignment=Slider(0, range=0..100))
colour_23 = ColourPicker(PickedColour=RGB(230, 230, 230))
separatorheight_14 = Slider(10, range=0..10)
width_94 = Slider(400, range=0..1000)
label_21 = CreateLabel(LabelText="Kinetic Unit for Continuous Translation", LabelSize=12, Justification=0)
adjustelem_16 = AdjustElementAppearance(ElementsToAdjust=label_21, Foreground=colour_22, FontSize=titlesize_10)
adjustpos_83 = AdjustElementPositioning(
    ElementsToAdjust=label_21,
    Margin="0,5,0,10",
    AbsolutePositioning=False,
    Width=width_93,
    Height=height_86,
    HorizontalAlignment=Slider(0, range=0..100))
width_95 = Slider(170, range=0..1000)
height_87 = Slider(30, range=0..1000)
width_96 = Slider(450, range=0..1000)
checkbox_6 = CreateCheckbox(Label="Add a lock", StartingValue=False)
height_88 = Slider(35, range=0..1000)
button_15 = CreateButton(ButtonName="Preview", ButtonStyle=0)
separator_14 = CreateSeparator(Thickness=0.5, Horizontal=True, Color=colour_23, Width=width_94, Height=separatorheight_14)
merge_6 = Merge(
    Data1=separator_13,
    Data2=label_21,
    Data3=button_14,
    Data4=button_13,
    Data5=image_3,
    Data6=button_12,
    Data7=slider_14,
    Data8=label_20,
    Data9=slider_15,
    Data10=label_19,
    Data11=separator_14,
    Data12=checkbox_6,
    Data13=button_15)
adjustpos_84 = AdjustElementPositioning(
    ElementsToAdjust=button_15,
    Margin="150,-45,0,10",
    AbsolutePositioning=False,
    Width=width_95,
    Height=height_87,
    HorizontalAlignment=Slider(0, range=0..100))
adjustpos_85 = AdjustElementPositioning(ElementsToAdjust=checkbox_6, Margin="15,15,0,10", AbsolutePositioning=False, Width=width_96, Height=height_88)
stack_6 = CreateStack(UIElements=merge_6, Horizontal=Toggle(False))
hideshow_8 = HideShowElement(ElementToHideShow=stack_6, Show=python_3.c, Collapse=Toggle(True), Disable=Toggle(False))

# ---- group: Instant Rotation Control Panel
number_slider = Slider(0, range=0..100)
c_script_4 = CSharpScript()  # -> out, A; same code as c_script
python_7 = GhPythonScript(x=c_script_4.A)  # -> a
# ---------- python_7: Python ----------
__author__ = "ediga"
__version__ = "2020.08.24"

import rhinoscriptsyntax as rs

idx = x.index("KinergyMainInterface.gh")

a = x[0:idx] + "Resources\images\insrot.png"
# ---------- end python_7 ----------
height_89 = Slider(30, range=0..30)
width_97 = Slider(50, range=0..400)
width_98 = Slider(150, range=0..1000)
height_90 = Slider(80, range=0..1000)
height_91 = Slider(30, range=0..30)
width_99 = Slider(50, range=0..400)
width_100 = Slider(117, range=0..1000)
height_92 = Slider(112, range=0..1000)
panel_9 = Panel(python_7)
label_22 = CreateLabel(LabelText="180°", LabelSize=12, Justification=0)
label_23 = CreateLabel(LabelText="Max", LabelSize=12, Justification=0)
adjustpos_86 = AdjustElementPositioning(
    ElementsToAdjust=label_22,
    Margin="295,-45,0,5",
    AbsolutePositioning=False,
    Width=width_97,
    Height=height_89,
    HorizontalAlignment=number_slider)
adjustelem_17 = AdjustElementAppearance(ElementsToAdjust=label_22, Background="255,255,255")
adjustpos_87 = AdjustElementPositioning(
    ElementsToAdjust=label_23,
    Margin="295,-45,0,5",
    AbsolutePositioning=False,
    Width=width_99,
    Height=height_91,
    HorizontalAlignment=number_slider)
adjustelem_18 = AdjustElementAppearance(ElementsToAdjust=label_23, Background="255,255,255")
image_4 = CreateImage(ImageSource=panel_9, ImageWidth=width_100, ImageHeight=height_92)
adjustpos_88 = AdjustElementPositioning(
    ElementsToAdjust=image_4,
    Margin="240,-90,0,10",
    AbsolutePositioning=False,
    Width=width_98,
    Height=height_90,
    HorizontalAlignment=Slider(0, range=0..100))
separatorheight_15 = Slider(4, range=0..10)
strength_7 = Slider(4, range=0..9)
colour_24 = ColourPicker(PickedColour=RGB(230, 230, 230))
max_angle = Slider(90, range=0..180)
width_101 = Slider(210, range=0..1000)
height_93 = Slider(30, range=0..1000)
width_102 = Slider(305, range=0..400)
height_94 = Slider(30, range=0..30)
width_103 = Slider(210, range=0..1000)
height_95 = Slider(30, range=0..1000)
width_104 = Slider(320, range=0..400)
height_96 = Slider(30, range=0..30)
titlesize_11 = Slider(18, range=0..30)
separator_15 = CreateSeparator(Thickness=0.5, Horizontal=True, Color=colour_24, Height=separatorheight_15)
colour_25 = ColourPicker(PickedColour=RGB(51, 121, 200))
button_16 = CreateButton(ButtonName="Select the end-effector", ButtonStyle=0)
slider_16 = CreateSlider(Slider=strength_7, ShowBounds=False, ShowTicks=False, ShowTooltip=False, ShowValLabel=True, showLabel=True)
slider_17 = CreateSlider(Slider=max_angle, ShowBounds=False, ShowTicks=False, ShowTooltip=False, ShowValLabel=True, showLabel=True)
button_17 = CreateButton(ButtonName="Select the region and axis", ButtonStyle=0)
width_105 = Slider(566, range=0..1000)
height_97 = Slider(38, range=0..1000)
adjustpos_89 = AdjustElementPositioning(
    ElementsToAdjust=slider_16,
    Margin="10,20,0,10",
    AbsolutePositioning=False,
    Width=width_102,
    Height=height_94,
    HorizontalAlignment=Slider(0, range=0..100))
adjustpos_90 = AdjustElementPositioning(
    ElementsToAdjust=button_16,
    Margin="10,5,0,10",
    AbsolutePositioning=False,
    Width=width_101,
    Height=height_93,
    HorizontalAlignment=Slider(0, range=0..100))
adjustpos_91 = AdjustElementPositioning(
    ElementsToAdjust=slider_17,
    Margin="10,10,0,5",
    AbsolutePositioning=False,
    Width=width_104,
    Height=height_96,
    HorizontalAlignment=Slider(0, range=0..100))
adjustpos_92 = AdjustElementPositioning(
    ElementsToAdjust=button_17,
    Margin="10,0,0,10",
    AbsolutePositioning=False,
    Width=width_103,
    Height=height_95,
    HorizontalAlignment=Slider(0, range=0..100))
colour_26 = ColourPicker(PickedColour=RGB(230, 230, 230))
separatorheight_16 = Slider(10, range=0..10)
width_106 = Slider(400, range=0..1000)
label_24 = CreateLabel(LabelText="Kinetic Unit for Instant Rotation", LabelSize=12, Justification=0)
adjustelem_19 = AdjustElementAppearance(ElementsToAdjust=label_24, Foreground=colour_25, FontSize=titlesize_11)
adjustpos_93 = AdjustElementPositioning(
    ElementsToAdjust=label_24,
    Margin="0,5,0,10",
    AbsolutePositioning=False,
    Width=width_105,
    Height=height_97,
    HorizontalAlignment=Slider(0, range=0..100))
width_107 = Slider(170, range=0..1000)
height_98 = Slider(30, range=0..1000)
width_108 = Slider(450, range=0..1000)
checkbox_7 = CreateCheckbox(Label="Add a lock", StartingValue=False)
height_99 = Slider(35, range=0..1000)
button_18 = CreateButton(ButtonName="Preview", ButtonStyle=0)
separator_16 = CreateSeparator(Thickness=0.5, Horizontal=True, Color=colour_26, Width=width_106, Height=separatorheight_16)
merge_7 = Merge(
    Data1=separator_15,
    Data2=label_24,
    Data3=button_17,
    Data4=button_16,
    Data5=image_4,
    Data6=slider_16,
    Data7=label_23,
    Data8=slider_17,
    Data9=label_22,
    Data10=separator_16,
    Data11=checkbox_7,
    Data12=button_18)
adjustpos_94 = AdjustElementPositioning(
    ElementsToAdjust=button_18,
    Margin="150,-45,0,10",
    AbsolutePositioning=False,
    Width=width_107,
    Height=height_98,
    HorizontalAlignment=Slider(0, range=0..100))
adjustpos_95 = AdjustElementPositioning(ElementsToAdjust=checkbox_7, Margin="15,15,0,10", AbsolutePositioning=False, Width=width_108, Height=height_99)
stack_7 = CreateStack(UIElements=merge_7, Horizontal=Toggle(False))
hideshow_9 = HideShowElement(ElementToHideShow=stack_7, Show=python_3.b, Collapse=Toggle(True), Disable=Toggle(False))

# ---- group: Instant Translation Control Panel
c_script_5 = CSharpScript()  # -> out, A; same code as c_script
python_8 = GhPythonScript(x=c_script_5.A)  # -> a
# ---------- python_8: Python ----------
__author__ = "ediga"
__version__ = "2020.08.24"

import rhinoscriptsyntax as rs

idx = x.index("KinergyMainInterface.gh")

a = x[0:idx] + "Resources\images\instrans.png"
# ---------- end python_8 ----------
width_109 = Slider(150, range=0..1000)
height_100 = Slider(80, range=0..1000)
height_101 = Slider(30, range=0..30)
width_110 = Slider(50, range=0..400)
width_111 = Slider(117, range=0..1000)
height_102 = Slider(112, range=0..1000)
height_103 = Slider(30, range=0..30)
width_112 = Slider(50, range=0..400)
panel_10 = Panel(python_8)
label_25 = CreateLabel(LabelText="Max", LabelSize=12, Justification=0)
label_26 = CreateLabel(LabelText="Max", LabelSize=12, Justification=0)
adjustpos_96 = AdjustElementPositioning(
    ElementsToAdjust=label_25,
    Margin="295,-45,0,5",
    AbsolutePositioning=False,
    Width=width_110,
    Height=height_101,
    HorizontalAlignment=Slider(0, range=0..100))
adjustelem_20 = AdjustElementAppearance(ElementsToAdjust=label_25, Background="255,255,255")
adjustpos_97 = AdjustElementPositioning(
    ElementsToAdjust=label_26,
    Margin="295,-45,0,5",
    AbsolutePositioning=False,
    Width=width_112,
    Height=height_103,
    HorizontalAlignment=Slider(0, range=0..100))
image_5 = CreateImage(ImageSource=panel_10, ImageWidth=width_111, ImageHeight=height_102)
adjustpos_98 = AdjustElementPositioning(
    ElementsToAdjust=image_5,
    Margin="240,-90,0,10",
    AbsolutePositioning=False,
    Width=width_109,
    Height=height_100,
    HorizontalAlignment=Slider(0, range=0..100))
adjustelem_21 = AdjustElementAppearance(ElementsToAdjust=label_26, Background="255,255,255")
strength_8 = Slider(4, range=0..9)
separatorheight_17 = Slider(4, range=0..10)
displacement = Slider(4, range=0..9)
colour_27 = ColourPicker(PickedColour=RGB(230, 230, 230))
width_113 = Slider(210, range=0..1000)
height_104 = Slider(30, range=0..1000)
width_114 = Slider(305, range=0..400)
height_105 = Slider(30, range=0..30)
width_115 = Slider(305, range=0..400)
height_106 = Slider(30, range=0..30)
width_116 = Slider(210, range=0..1000)
height_107 = Slider(30, range=0..1000)
slider_18 = CreateSlider(Slider=strength_8, ShowBounds=False, ShowTicks=False, ShowTooltip=False, ShowValLabel=True, showLabel=True)
titlesize_12 = Slider(18, range=0..30)
separator_17 = CreateSeparator(Thickness=0.5, Horizontal=True, Color=colour_27, Height=separatorheight_17)
colour_28 = ColourPicker(PickedColour=RGB(51, 121, 200))
button_19 = CreateButton(ButtonName="Select the end-effector", ButtonStyle=0)
slider_19 = CreateSlider(Slider=displacement, ShowBounds=False, ShowTicks=False, ShowTooltip=False, ShowValLabel=True, showLabel=True)
button_20 = CreateButton(ButtonName="Select the region and direction", ButtonStyle=0)
width_117 = Slider(566, range=0..1000)
height_108 = Slider(38, range=0..1000)
adjustpos_99 = AdjustElementPositioning(
    ElementsToAdjust=slider_19,
    Margin="10,20,0,10",
    AbsolutePositioning=False,
    Width=width_114,
    Height=height_105,
    HorizontalAlignment=Slider(0, range=0..100))
adjustpos_100 = AdjustElementPositioning(
    ElementsToAdjust=button_19,
    Margin="10,5,0,10",
    AbsolutePositioning=False,
    Width=width_113,
    Height=height_104,
    HorizontalAlignment=Slider(0, range=0..100))
adjustpos_101 = AdjustElementPositioning(
    ElementsToAdjust=button_20,
    Margin="10,0,0,10",
    AbsolutePositioning=False,
    Width=width_116,
    Height=height_107,
    HorizontalAlignment=Slider(0, range=0..100))
adjustpos_102 = AdjustElementPositioning(
    ElementsToAdjust=slider_18,
    Margin="10,10,0,5",
    AbsolutePositioning=False,
    Width=width_115,
    Height=height_106,
    HorizontalAlignment=Slider(0, range=0..100))
colour_29 = ColourPicker(PickedColour=RGB(230, 230, 230))
separatorheight_18 = Slider(10, range=0..10)
width_118 = Slider(400, range=0..1000)
label_27 = CreateLabel(LabelText="Kinetic Unit for Instant Translation", LabelSize=12, Justification=0)
adjustelem_22 = AdjustElementAppearance(ElementsToAdjust=label_27, Foreground=colour_28, FontSize=titlesize_12)
adjustpos_103 = AdjustElementPositioning(
    ElementsToAdjust=label_27,
    Margin="0,5,0,10",
    AbsolutePositioning=False,
    Width=width_117,
    Height=height_108,
    HorizontalAlignment=Slider(0, range=0..100))
width_119 = Slider(170, range=0..1000)
height_109 = Slider(30, range=0..1000)
width_120 = Slider(450, range=0..1000)
checkbox_8 = CreateCheckbox(Label="Add a lock", StartingValue=False)
height_110 = Slider(35, range=0..1000)
button_21 = CreateButton(ButtonName="Preview", ButtonStyle=0)
separator_18 = CreateSeparator(Thickness=0.5, Horizontal=True, Color=colour_29, Width=width_118, Height=separatorheight_18)
merge_8 = Merge(
    Data1=separator_17,
    Data2=label_27,
    Data3=button_20,
    Data4=button_19,
    Data5=image_5,
    Data6=slider_19,
    Data7=label_26,
    Data8=slider_18,
    Data9=label_25,
    Data10=separator_18,
    Data11=checkbox_8,
    Data12=button_21)
adjustpos_104 = AdjustElementPositioning(
    ElementsToAdjust=button_21,
    Margin="150,-45,0,10",
    AbsolutePositioning=False,
    Width=width_119,
    Height=height_109,
    HorizontalAlignment=Slider(0, range=0..100))
adjustpos_105 = AdjustElementPositioning(ElementsToAdjust=checkbox_8, Margin="15,15,0,10", AbsolutePositioning=False, Width=width_120, Height=height_110)
stack_8 = CreateStack(UIElements=merge_8, Horizontal=Toggle(False))
hideshow_10 = HideShowElement(ElementToHideShow=stack_8, Show=python_3.a, Collapse=Toggle(True), Disable=Toggle(False))

# ---- group: Intermittent Rotation Control Panel
width_121 = Slider(80, range=0..1000)
height_111 = Slider(30, range=0..1000)
height_112 = Slider(34, range=0..1000)
width_122 = Slider(140, range=0..1000)
c_script_6 = CSharpScript()  # -> out, A; same code as c_script
height_113 = Slider(30, range=0..30)
width_123 = Slider(50, range=0..400)
python_9 = GhPythonScript(x=c_script_6.A)  # -> a
# ---------- python_9: Python ----------
__author__ = "ediga"
__version__ = "2020.08.24"

import rhinoscriptsyntax as rs

idx = x.index("KinergyMainInterface.gh")

a = x[0:idx] + "Resources\images\introt.png"
# ---------- end python_9 ----------
height_114 = Slider(80, range=0..1000)
width_124 = Slider(150, range=0..1000)
textbox = CreateTextBox(Label="Step angle (0°-90°):", UpdateButton=Toggle(False), showLabel=True)
panel_11 = Panel("""Slow
Regular
Fast""")
width_125 = Slider(117, range=0..1000)
height_115 = Slider(112, range=0..1000)
panel_12 = Panel(python_9)
label_28 = CreateLabel(LabelText="Max", LabelSize=12, Justification=0)
button_22 = CreateButton(ButtonName="Set the input", ButtonStyle=0)
pulldown_4 = CreatePulldownMenu(Label="Speed", ListItems=panel_11, showLabel=True)
adjustpos_106 = AdjustElementPositioning(
    ElementsToAdjust=label_28,
    Margin="295,-45,0,5",
    AbsolutePositioning=False,
    Width=width_123,
    Height=height_113,
    HorizontalAlignment=Slider(0, range=0..100))
adjustelem_23 = AdjustElementAppearance(ElementsToAdjust=label_28, Background="255,255,255")
adjustpos_107 = AdjustElementPositioning(
    ElementsToAdjust=button_22,
    Margin="10,-40,0,10",
    AbsolutePositioning=False,
    Width=width_121,
    Height=height_111,
    HorizontalAlignment=Slider(0, range=0..100))
adjustpos_108 = AdjustElementPositioning(
    ElementsToAdjust=pulldown_4,
    Margin="180,-40,0,10",
    AbsolutePositioning=False,
    Width=width_122,
    Height=height_112,
    HorizontalAlignment=Slider(0, range=0..100))
image_6 = CreateImage(ImageSource=panel_12, ImageWidth=width_125, ImageHeight=height_115)
adjustpos_109 = AdjustElementPositioning(
    ElementsToAdjust=image_6,
    Margin="240,-90,0,10",
    AbsolutePositioning=False,
    Width=width_124,
    Height=height_114,
    HorizontalAlignment=Slider(0, range=0..100))
separatorheight_19 = Slider(4, range=0..10)
strength_9 = Slider(4, range=0..9)
colour_30 = ColourPicker(PickedColour=RGB(230, 230, 230))
width_126 = Slider(122, range=0..1000)
height_116 = Slider(30, range=0..1000)
width_127 = Slider(305, range=0..400)
height_117 = Slider(30, range=0..30)
width_128 = Slider(210, range=0..1000)
height_118 = Slider(30, range=0..1000)
width_129 = Slider(160, range=0..400)
height_119 = Slider(30, range=0..30)
titlesize_13 = Slider(18, range=0..30)
separator_19 = CreateSeparator(Thickness=0.5, Horizontal=True, Color=colour_30, Height=separatorheight_19)
colour_31 = ColourPicker(PickedColour=RGB(51, 121, 200))
button_23 = CreateButton(ButtonName="Select the end-effector", ButtonStyle=0)
slider_20 = CreateSlider(Slider=strength_9, ShowBounds=False, ShowTicks=False, ShowTooltip=False, ShowValLabel=True, showLabel=True)
button_24 = CreateButton(ButtonName="Select the region and axis", ButtonStyle=0)
width_130 = Slider(566, range=0..1000)
height_120 = Slider(38, range=0..1000)
adjustpos_110 = AdjustElementPositioning(
    ElementsToAdjust=slider_20,
    Margin="10,20,0,10",
    AbsolutePositioning=False,
    Width=width_127,
    Height=height_117,
    HorizontalAlignment=Slider(0, range=0..100))
adjustpos_111 = AdjustElementPositioning(
    ElementsToAdjust=button_23,
    Margin="100,5,0,10",
    AbsolutePositioning=False,
    Width=width_126,
    Height=height_116,
    HorizontalAlignment=Slider(0, range=0..100))
adjustpos_112 = AdjustElementPositioning(
    ElementsToAdjust=textbox,
    Margin="10,5,0,5",
    AbsolutePositioning=False,
    Width=width_129,
    Height=height_119,
    HorizontalAlignment=Slider(0, range=0..100))
adjustpos_113 = AdjustElementPositioning(
    ElementsToAdjust=button_24,
    Margin="10,0,0,10",
    AbsolutePositioning=False,
    Width=width_128,
    Height=height_118,
    HorizontalAlignment=Slider(0, range=0..100))
colour_32 = ColourPicker(PickedColour=RGB(230, 230, 230))
separatorheight_20 = Slider(10, range=0..10)
width_131 = Slider(400, range=0..1000)
label_29 = CreateLabel(LabelText="Kinetic Unit for Intermittent Rotation", LabelSize=12, Justification=0)
adjustelem_24 = AdjustElementAppearance(ElementsToAdjust=label_29, Foreground=colour_31, FontSize=titlesize_13)
adjustpos_114 = AdjustElementPositioning(
    ElementsToAdjust=label_29,
    Margin="0,5,0,10",
    AbsolutePositioning=False,
    Width=width_130,
    Height=height_120,
    HorizontalAlignment=Slider(0, range=0..100))
width_132 = Slider(170, range=0..1000)
height_121 = Slider(30, range=0..1000)
width_133 = Slider(450, range=0..1000)
height_122 = Slider(35, range=0..1000)
checkbox_9 = CreateCheckbox(Label="Add a lock", StartingValue=False)
button_25 = CreateButton(ButtonName="Preview", ButtonStyle=0)
separator_20 = CreateSeparator(Thickness=0.5, Horizontal=True, Color=colour_32, Width=width_131, Height=separatorheight_20)
merge_9 = Merge(
    Data1=separator_19,
    Data2=label_29,
    Data3=button_24,
    Data4=button_23,
    Data5=image_6,
    Data6=button_22,
    Data7=slider_20,
    Data8=label_28,
    Data9=textbox,
    Data10=pulldown_4,
    Data11=separator_20,
    Data12=checkbox_9,
    Data13=button_25)
adjustpos_115 = AdjustElementPositioning(
    ElementsToAdjust=button_25,
    Margin="150,-45,0,10",
    AbsolutePositioning=False,
    Width=width_132,
    Height=height_121,
    HorizontalAlignment=Slider(0, range=0..100))
adjustpos_116 = AdjustElementPositioning(ElementsToAdjust=checkbox_9, Margin="15,15,0,10", AbsolutePositioning=False, Width=width_133, Height=height_122)
stack_9 = CreateStack(UIElements=merge_9, Horizontal=Toggle(False))
hideshow_11 = HideShowElement(ElementToHideShow=stack_9, Show=python_3.h, Collapse=Toggle(True), Disable=Toggle(False))

# ---- group: Continuous Rotation Control Panel
width_134 = Slider(80, range=0..1000)
height_123 = Slider(30, range=0..1000)
height_124 = Slider(30, range=0..30)
width_135 = Slider(50, range=0..400)
c_script_7 = CSharpScript()  # -> out, A; same code as c_script
python_10 = GhPythonScript(x=c_script_7.A)  # -> a
# ---------- python_10: Python ----------
__author__ = "ediga"
__version__ = "2020.08.24"

import rhinoscriptsyntax as rs

idx = x.index("KinergyMainInterface.gh")

a = x[0:idx] + "Resources\images\conrot.png"
# ---------- end python_10 ----------
height_125 = Slider(30, range=0..30)
width_136 = Slider(50, range=0..400)
width_137 = Slider(150, range=0..1000)
height_126 = Slider(80, range=0..1000)
label_30 = CreateLabel(LabelText="Max", LabelSize=12, Justification=0)
width_138 = Slider(117, range=0..1000)
height_127 = Slider(112, range=0..1000)
panel_13 = Panel(python_10)
button_26 = CreateButton(ButtonName="Set the input", ButtonStyle=0)
label_31 = CreateLabel(LabelText="Max", LabelSize=12, Justification=0)
adjustpos_117 = AdjustElementPositioning(
    ElementsToAdjust=label_30,
    Margin="295,-45,0,5",
    AbsolutePositioning=False,
    Width=width_135,
    Height=height_124,
    HorizontalAlignment=Slider(0, range=0..100))
adjustelem_25 = AdjustElementAppearance(ElementsToAdjust=label_30, Background="255,255,255")
adjustpos_118 = AdjustElementPositioning(
    ElementsToAdjust=button_26,
    Margin="10,-40,0,10",
    AbsolutePositioning=False,
    Width=width_134,
    Height=height_123,
    HorizontalAlignment=Slider(0, range=0..100))
adjustpos_119 = AdjustElementPositioning(
    ElementsToAdjust=label_31,
    Margin="295,-45,0,5",
    AbsolutePositioning=False,
    Width=width_136,
    Height=height_125,
    HorizontalAlignment=Slider(0, range=0..100))
adjustelem_26 = AdjustElementAppearance(ElementsToAdjust=label_31, Background="255,255,255")
image_7 = CreateImage(ImageSource=panel_13, ImageWidth=width_138, ImageHeight=height_127)
adjustpos_120 = AdjustElementPositioning(
    ElementsToAdjust=image_7,
    Margin="240,-90,0,10",
    AbsolutePositioning=False,
    Width=width_137,
    Height=height_126,
    HorizontalAlignment=Slider(0, range=0..100))
separatorheight_21 = Slider(4, range=0..10)
strength_10 = Slider(4, range=0..9)
colour_33 = ColourPicker(PickedColour=RGB(230, 230, 230))
rounds_2 = Slider(4, range=0..9)
width_139 = Slider(122, range=0..1000)
height_128 = Slider(30, range=0..1000)
width_140 = Slider(305, range=0..400)
height_129 = Slider(30, range=0..30)
width_141 = Slider(210, range=0..1000)
height_130 = Slider(30, range=0..1000)
width_142 = Slider(305, range=0..400)
height_131 = Slider(30, range=0..30)
titlesize_14 = Slider(18, range=0..30)
separator_21 = CreateSeparator(Thickness=0.5, Horizontal=True, Color=colour_33, Height=separatorheight_21)
colour_34 = ColourPicker(PickedColour=RGB(51, 121, 200))
button_27 = CreateButton(ButtonName="Select the end-effector", ButtonStyle=0)
slider_21 = CreateSlider(Slider=strength_10, ShowBounds=False, ShowTicks=False, ShowTooltip=False, ShowValLabel=True, showLabel=True)
slider_22 = CreateSlider(Slider=rounds_2, ShowBounds=False, ShowTicks=False, ShowTooltip=False, ShowValLabel=True, showLabel=True)
button_28 = CreateButton(ButtonName="Select the region and axis", ButtonStyle=0)
width_143 = Slider(566, range=0..1000)
height_132 = Slider(38, range=0..1000)
adjustpos_121 = AdjustElementPositioning(
    ElementsToAdjust=slider_21,
    Margin="10,20,0,10",
    AbsolutePositioning=False,
    Width=width_140,
    Height=height_129,
    HorizontalAlignment=Slider(0, range=0..100))
adjustpos_122 = AdjustElementPositioning(
    ElementsToAdjust=button_27,
    Margin="100,5,0,10",
    AbsolutePositioning=False,
    Width=width_139,
    Height=height_128,
    HorizontalAlignment=Slider(0, range=0..100))
adjustpos_123 = AdjustElementPositioning(
    ElementsToAdjust=slider_22,
    Margin="10,10,0,5",
    AbsolutePositioning=False,
    Width=width_142,
    Height=height_131,
    HorizontalAlignment=Slider(0, range=0..100))
adjustpos_124 = AdjustElementPositioning(
    ElementsToAdjust=button_28,
    Margin="10,0,0,10",
    AbsolutePositioning=False,
    Width=width_141,
    Height=height_130,
    HorizontalAlignment=Slider(0, range=0..100))
colour_35 = ColourPicker(PickedColour=RGB(230, 230, 230))
separatorheight_22 = Slider(10, range=0..10)
width_144 = Slider(400, range=0..1000)
label_32 = CreateLabel(LabelText="Kinetic Unit for Continuous Rotation", LabelSize=12, Justification=0)
adjustelem_27 = AdjustElementAppearance(ElementsToAdjust=label_32, Foreground=colour_34, FontSize=titlesize_14)
adjustpos_125 = AdjustElementPositioning(
    ElementsToAdjust=label_32,
    Margin="0,5,0,10",
    AbsolutePositioning=False,
    Width=width_143,
    Height=height_132,
    HorizontalAlignment=Slider(0, range=0..100))
width_145 = Slider(170, range=0..1000)
height_133 = Slider(30, range=0..1000)
width_146 = Slider(450, range=0..1000)
height_134 = Slider(35, range=0..1000)
checkbox_10 = CreateCheckbox(Label="Add a lock", StartingValue=False)
button_29 = CreateButton(ButtonName="Preview", ButtonStyle=0)
separator_22 = CreateSeparator(Thickness=0.5, Horizontal=True, Color=colour_35, Width=width_144, Height=separatorheight_22)
merge_10 = Merge(
    Data1=separator_21,
    Data2=label_32,
    Data3=button_28,
    Data4=button_27,
    Data5=image_7,
    Data6=button_26,
    Data7=slider_21,
    Data8=label_30,
    Data9=slider_22,
    Data10=label_31,
    Data11=separator_22,
    Data12=checkbox_10,
    Data13=button_29)
adjustpos_126 = AdjustElementPositioning(
    ElementsToAdjust=button_29,
    Margin="150,-45,0,10",
    AbsolutePositioning=False,
    Width=width_145,
    Height=height_133,
    HorizontalAlignment=Slider(0, range=0..100))
adjustpos_127 = AdjustElementPositioning(ElementsToAdjust=checkbox_10, Margin="15,15,0,10", AbsolutePositioning=False, Width=width_146, Height=height_134)
stack_10 = CreateStack(UIElements=merge_10, Horizontal=Toggle(False))
hideshow_12 = HideShowElement(ElementToHideShow=stack_10, Show=python_3.d, Collapse=Toggle(True), Disable=Toggle(False))

# ---- group: Default Control Panel
width_147 = Slider(860, range=0..1000)
height_135 = Slider(35, range=0..1000)
colour_36 = ColourPicker(PickedColour=RGB(200, 200, 200))
label_33 = CreateLabel(LabelText="Please select the target motion...", LabelSize=12, Justification=0)
adjustpos_128 = AdjustElementPositioning(
    ElementsToAdjust=label_33,
    Margin="75,100,0,10",
    AbsolutePositioning=False,
    Width=width_147,
    Height=height_135,
    HorizontalAlignment=Slider(0, range=0..100))
stack_11 = CreateStack(UIElements=label_33, Horizontal=Toggle(False))
hideshow_13 = HideShowElement(ElementToHideShow=stack_11, Show=python_3.e, Collapse=Toggle(True), Disable=Toggle(False))
adjustelem_28 = AdjustElementAppearance(ElementsToAdjust=label_33, Foreground=colour_36)

# ----
previewvaluelistener = ValueListener(Elements=button_21, SomeProperty=True)  # -> Values, Indices
toggle = BooleanToggle(True)
setregionvaluelistener = ValueListener(Elements=button_20, SomeProperty=True)  # -> Values, Indices
lockvaluelistener = ValueListener(Elements=checkbox_8, SomeProperty=True)  # -> Values, Indices
setendeffectorvaluelistener = ValueListener(Elements=button_19, SomeProperty=True)  # -> Values, Indices
energyvaluelistener = ValueListener(Elements=slider_18, SomeProperty=True)  # -> Values, Indices
regionselection = RegionSelection(Restart=setregionvaluelistener.Values, SelectDirection=toggle, SelectRegion=toggle)  # -> ModelRegionOfInterest, InnerCavity, Skeleton, Direction, Trigger, SkeletonStartPos, SkeletonEndPos, OriginalBrep
displacementvaluelistener = ValueListener(Elements=slider_19, SomeProperty=True)  # -> Values, Indices
it = InstantTranslation(
    Start=regionselection.Trigger,
    Model=regionselection.ModelRegionOfInterest,
    MotionDirection=regionselection.Direction,
    CurvedModel=Toggle(False),
    Energy=energyvaluelistener.Values,
    Distance=displacementvaluelistener.Values,
    SkeletonStartPos=regionselection.SkeletonStartPos,
    SkeletonEndPos=regionselection.SkeletonEndPos,
    OriginalBrep=regionselection.OriginalBrep)  # -> InstantTranslationKineticUnit, LockDirectionCandidates
instant_rotation_visability = Panel(python_3.b)
instant_translation_visability = Panel(python_3.a)
continuous_translation_visability = Panel(python_3.c)
continuous_rotation_visability = Panel(python_3.d)
intermittent_oscillation_visability = Panel(python_3.g)
reciprocation_visability = Panel(python_3.f)
intermittent_rotation_visability = Panel(python_3.h)
default_visability = Panel(python_3.e)
end_effectorselection = EndEffectorSelectionForHelical(Select=setendeffectorvaluelistener.Values, DirectionCandidates=it.LockDirectionCandidates)
additlock = GenerateLockForInstantTranslation(
    Enable=lockvaluelistener.Values,
    KineticUnit=it.InstantTranslationKineticUnit,
    SelectedEndEffectorDirection=end_effectorselection)  # -> KineticUnit, Models

# ---- group: Reset Motion
width_148 = Slider(50, range=0..1000)
height_136 = Slider(30, range=0..1000)
button_30 = CreateButton(ButtonName="Clear", ButtonStyle=0)
adjustpos_129 = AdjustElementPositioning(
    ElementsToAdjust=button_30,
    Margin="270,-45,0,10",
    AbsolutePositioning=False,
    Width=width_148,
    Height=height_136,
    HorizontalAlignment=Slider(0, range=0..100))
values_14 = ValueListener(Elements=button_30, SomeProperty=True)  # -> Values, Indices

# ---- group: MAIN WINDOW
merge_11 = Merge(
    Data1=label_12,
    Data2=label_11,
    Data3=radiobtn_11,
    Data4=radiobtn_13,
    Data5=radiobtn_12,
    Data6=label_10,
    Data7=radiobtn_7,
    Data8=radiobtn_8,
    Data9=radiobtn_9,
    Data10=radiobtn_10,
    Data11=stack_11,
    Data12=stack_8,
    Data13=stack_7,
    Data14=stack_6,
    Data15=stack_10,
    Data16=stack_4,
    Data17=stack_5,
    Data18=stack_9)
launchwin = LaunchWindow(
    Show=Toggle(True),
    Name="Kinergy Design Tool",
    Width=Slider(350, range=0..1000),
    Height=Slider(630, range=0..1000),
    ChildStatus=0,
    EnableHorizScroll=False)
addelems = AddElements(Window=launchwin, Elements=flatten(merge_11), DoVLChecking=True)  # -> AddedElements, ElementNames

# ---- group: Preview of Instant Translation
button_31 = CreateButton(ButtonName="Release", ButtonStyle=0)
button_32 = CreateButton(ButtonName="Load energy", ButtonStyle=0)
_3dview = Create3DView(MeshColors=RGB(255, 0, 0), ViewWidth=300, ViewHeight=300)
merge_12 = Merge(Data1=button_32, Data2=button_31)
stack_12 = CreateStack(UIElements=merge_12, Horizontal=True)
merge_13 = Merge(Data1=_3dview, Data2=stack_12)
expander = CreateExpander(UIElements=merge_13, Open=True)
rgb = ColourRGB(Alpha=255, Red="255", Green=0, Blue=0)
values_15 = ValueListener(Elements=button_31, SomeProperty=True)  # -> Values, Indices
values_16 = ValueListener(Elements=button_32, SomeProperty=True)  # -> Values, Indices
launchwin_2 = LaunchWindow(Show=previewvaluelistener.Values, Name="Motion Preview", Width=370, Height=400, ChildStatus=0, EnableHorizScroll=False)
addelems_2 = AddElements(Window=launchwin_2, Elements=flatten(expander), DoVLChecking=True)  # -> AddedElements, ElementNames
kms = KinergyMotionSimulatorForHumanUI(
    _3DView=_3dview,
    KineticUnitToSimulate=additlock.KineticUnit,
    MeshColors=rgb,
    Start=previewvaluelistener.Values,
    Load=values_16.Values,
    Release=values_15.Values)
childwin = MakeChildWindow(ParentWindow=launchwin, ChildWindow=launchwin_2)
